# Dynamo graph TestReadDefinition.dyn (Dynamo 2.0.1.5055)

file_path = Filename(".\TestModel.skp")
boolean = BoolSelector(true)  # graph input
loadModel = SketchUpForDynamo.SketchUp.LoadModel(path=file_path, includeMeshes=boolean)
getInstance = SketchUpForDynamo.SketchUp.GetInstance(instance=loadModel.Instances)
