# Grasshopper definition TestDefinition.gh (Grasshopper 1.0.7)
# plug-ins: SketchUpForGrasshopper

# ----
# Get Sample File
panel = Panel("TestModel.skp")
vb = VBScript()  # -> out, A
# ---------- vb: C# ----------
    A= owner.OnPingDocument().FilePath
# ---------- end vb ----------
rep = ReplaceText(Text=vb.A, Find="TestDefinition.gh", Replace=panel, RecursiveReplace=False)

sketch_up_model = SketchUpModel(Path=rep)  # -> Surfaces, Layers, Instances
srf = Surface(sketch_up_model.Surfaces)
decompose_sketchup_instance = DecomposeSketchUpInstance(Instance=sketch_up_model.Instances)  # -> Location, Name, Scale, Surfaces, ParentName, Inner
